# Grasshopper definition hehe.gh (Grasshopper 0.9.76)
# plug-ins: Python Interpreter

xy_plane = XYPlane(Origin=Point(0, 0, 0))
circle = Circle(Plane=xy_plane, Radius=Slider(120, range=0..1000))
cir = Circle(Plane=xy_plane, Radius=Slider(35, range=0..100))
Z = UnitZ(Factor=1)
geo = Geometry(<brep referenced from the Rhino model>)
series = Series(Start=Slider(0, range=0..100), Step=Slider(19, range=0..100), Count=Slider(13, range=0..100))
join = TextJoin(Join=",")  # -> flatten(Result)
face = Geometry(<brep referenced from the Rhino model>)
multiplication = Multiplication(A=Z, B=Slider(250, range=0..1000))
mesh = Mesh(geo)
extr = Extrude(Base=cir, Direction=multiplication)
panel = Panel(face)
join_2 = TextJoin(Text=join, Join="&")
Z_2 = UnitZ(Factor=series)
number_slider = Slider(0, range=0..100)

series_2 = Series(Start=Slider(1, range=0..100), Step=Slider(1, range=0..1), Count=Slider(9, range=0..30))

series_3 = Series(Start=Slider(1, range=0..1), Step=Slider(1, range=0..1), Count=Slider(5, range=0..100))
panel_2 = Panel(series_3)

# ---- group: copy
python_script = PythonScript(x=Slider(10, range=0..10), y=Slider(0.5, range=0..1), z=Slider(41, range=0..100))  # -> out, a
# ---------- python_script: Python ----------
__author__ = "umida"

import rhinoscriptsyntax as rs




a = list();
a.append(0);
for i in range(0,41):
  h = (20.0 + 0.25*i )*(i+1)/2;
  a.append(h);
# ---------- end python_script ----------
unit_z = UnitZ(Factor=1)
move = Move(Geometry=circle, Motion=Z_2)  # -> Geometry, Transform

# ----
multiplication_2 = Multiplication(A=Slider(0.566, range=0..1), B=python_script.a)

# ---- group: copy (continued)
multiplication_3 = Multiplication(A=multiplication_2, B=unit_z)

# ----
divide_curve = DivideCurve(Curve=move.Geometry, Count=Slider(18, range=0..100), Kinks=False)  # -> Points, Tangents, Parameters
panel_3 = Panel(divide_curve.Points)
pdecon = Deconstruct(Point=panel_3)  # -> XComponent, YComponent, ZComponent
panel_4 = Panel(pdecon.ZComponent)
pt = ConstructPoint(XCoordinate=number_slider, YCoordinate=number_slider, ZCoordinate=pdecon.ZComponent)
ln = Line(StartPoint=panel_3, EndPoint=pt)
panel_5 = Panel(ln)
mcx = MeshCurve(Mesh=mesh, Curve=ln)  # -> Points, Faces
panel_6 = Panel(mcx.Points)
list_item = ListItem(List=panel_6, Index=0, Wrap=True)
trim = TrimTree(Tree=list_item, Depth=1)
vec2pt = Vector2Pt(PointA=panel_3, PointB=trim, Unitize=False)  # -> Vector, Length
move_2 = Move(Geometry=panel_3, Motion=vec2pt.Vector)  # -> Geometry, Transform

# ---- group: 奇数偶数层分离
cull_pattern = CullPattern(List=move_2.Geometry, CullPattern=[False, True])  # -> simplify(List)
cull_pattern_2 = CullPattern(List=move_2.Geometry, CullPattern=[True, False])
flip_matrix = FlipMatrix(Data=cull_pattern_2)
flip_matrix_2 = FlipMatrix(Data=cull_pattern)
cull_pattern_3 = CullPattern(List=flip_matrix, CullPattern=[True, False])
cull_pattern_4 = CullPattern(List=flip_matrix_2, CullPattern=[False, True])
flip_matrix_3 = FlipMatrix(Data=cull_pattern_4)
flip_matrix_4 = FlipMatrix(Data=cull_pattern_3)
geometry = Geometry(flip_matrix_4)
geometry_2 = Geometry(flip_matrix_3)

# ----
panel_7 = Panel(cull_pattern)
panel_8 = Panel(geometry_2)
panel_9 = Panel(move_2.Geometry)
panel_10 = Panel(trim)
panel_11 = Panel(geometry)

# ---- group: 编织
series_4 = Series(Start=0, Step=1, Count=Slider(9, range=0..100))
list_item_2 = ListItem(List=panel_11, Index=series_4, Wrap=True)
flip_matrix_5 = FlipMatrix(Data=list_item_2)
cull_pattern_5 = CullPattern(List=flip_matrix_5, CullPattern=[False, True, True, True, True, True])
flip_matrix_6 = FlipMatrix(Data=cull_pattern_5)
shift = ShiftList(List=flip_matrix_6, Shift=Slider(1, range=0..1), Wrap=True)

series_5 = Series(Start=0, Step=1, Count=Slider(9, range=0..100))
list_item_3 = ListItem(List=geometry_2, Index=series_5, Wrap=True)
flip_matrix_7 = FlipMatrix(Data=list_item_3)
cull_pattern_6 = CullPattern(List=flip_matrix_7, CullPattern=[True, True, True, True, True, False])
flip_matrix_8 = FlipMatrix(Data=cull_pattern_6)
insert_items = InsertItems(List=flip_matrix_8, Item=shift, Indices=series_2, Wrap=True)
insert_items_2 = InsertItems(List=list_item_2, Item=list_item_3, Indices=series_2, Wrap=True)

# ----
panel_12 = Panel(flip_matrix_7)
panel_13 = Panel(flip_matrix_8)
panel_14 = Panel(shift)
panel_15 = Panel(insert_items)
panel_16 = Panel(insert_items_2)
flip = FlipMatrix(Data=panel_15)
flip_2 = FlipMatrix(Data=panel_16)
ins = InsertItems(List=flip_2, Item=flip, Indices=series_3, Wrap=True)
flip_3 = FlipMatrix(Data=ins)
panel_17 = Panel(flip_3)
trim_tree = TrimTree(Tree=panel_17, Depth=3)
panel_18 = Panel(trim_tree)
intcrv = Interpolate(Vertices=panel_18, Degree=3, Periodic=True, KnotStyle=1)  # -> Curve, Length, Domain
trim_2 = TrimTree(Tree=panel_18, Depth=2)
deconstruct = Deconstruct(Point=trim_2)  # -> graft(XComponent), graft(YComponent), graft(ZComponent)
panel_19 = Panel(intcrv.Curve)
panel_20 = Panel(trim_2)
pdecon_2 = Deconstruct(Point=trim_2)  # -> graft(XComponent), graft(YComponent), graft(ZComponent)
merge = Merge(Data1=deconstruct.XComponent, Data2=deconstruct.YComponent, Data3=deconstruct.ZComponent)
panel_21 = Panel(deconstruct.XComponent)
panel_22 = Panel(merge)
txt = Text(deconstruct.XComponent)
panel_23 = Panel(deconstruct.YComponent)
join_3 = TextJoin(Text=merge, Join=",")  # -> flatten(Result)
panel_24 = Panel(txt)
panel_25 = Panel(deconstruct.ZComponent)
panel_26 = Panel(join_3)
join_4 = TextJoin(Text=join_3, Join="&")
panel_27 = Panel(join_4)
